# Grasshopper definition http-degree-data-request.gh (Grasshopper 1.0.7)

python = GhPythonScript(x=Slider(360, range=0..360))  # -> out, a
# ---------- python: Python ----------
__author__ = "tnkse"
__version__ = "2021.01.22"

import rhinoscriptsyntax as rs

print(x)

# coding: UTF-8
 
import urllib2
import json
 
params = {}
 
### JSON データ設定
params["degree"] = x
 
### HTTP リクエスト設定
# python3 https://docs.python.org/ja/3/library/urllib.request.html
# python2 https://docs.python.org/ja/2.7/library/urllib2.html
 
# JSON データを文字列化
data = json.dumps(params)
# print(data)
 
# Content-Type application/json を HTTP Header に加える
# Node-RED の URL
url = 'http://192.168.1.130:1880/cmd/MoveTo/PositionDeg'
request = urllib2.Request(url)
request.add_header('Content-Type','application/json')
 
# POST リクエスト
response = urllib2.urlopen(request,data)
 
### HTTP レスポンス
print('code',response.getcode())
# 結果 : ('code', 200)
 
# 返答データを抽出
response_data = response.read()
print('response_data',response_data)
# 結果 : ('response_data', '{"result":"OK"}')
 
# さらに返答データを JSON として取り出す
response_json = json.loads(response_data)
print('response_json["result"]',response_json["result"])
# 結果 : ('response_json["result"]', u'OK')
# ---------- end python ----------
panel = Panel(python.out)
