# Grasshopper definition http-slider-data-request.gh (Grasshopper 1.0.7)

python = GhPythonScript(x=Slider(0.25, range=0..1))  # -> out, a
# ---------- python: Python ----------
__author__ = "tnkse"
__version__ = "2021.01.22"

import rhinoscriptsyntax as rs

print(x)

# coding: UTF-8
 
import urllib2
import json
 
params = {}
 
### JSON データ設定
# https://docs.python.org/ja/3/library/json.html
 
# Dictionary(object)
params["x"] = 10
params["y"] = -10
params["z"] = 5

params["message"] = x
 
# Array
params["arr"] = []
params["arr"].append(["id1","A"]) # append Array
params["arr"].append(["id2","B"]) # append Array
params["arr"].append({"id3":"C"}) # append Object
params["arr"].append({"id4":"D"}) # append Object
 
### HTTP リクエスト設定
# python3 https://docs.python.org/ja/3/library/urllib.request.html
# python2 https://docs.python.org/ja/2.7/library/urllib2.html
 
# JSON データを文字列化
data = json.dumps(params)
# print(data)
 
# Content-Type application/json を HTTP Header に加える
url = 'http://localhost:1880/test'
request = urllib2.Request(url)
request.add_header('Content-Type','application/json')
 
# POST リクエスト
response = urllib2.urlopen(request,data)
 
### HTTP レスポンス
print('code',response.getcode())
# 結果 : ('code', 200)
 
# 返答データを抽出
response_data = response.read()
print('response_data',response_data)
# 結果 : ('response_data', '{"result":"OK"}')
 
# さらに返答データを JSON として取り出す
response_json = json.loads(response_data)
print('response_json["result"]',response_json["result"])
# 結果 : ('response_json["result"]', u'OK')
# ---------- end python ----------
panel = Panel(python.out)
